# Dynamo graph DeleteElements.dyn (Dynamo 0.9.1.4062)

python_script = Python()
# ---------- python_script.python (36 lines) ----------
import clr
clr.AddReference('ProtoGeometry')
from Autodesk.DesignScript.Geometry import *

clr.AddReference('RevitAPI')
import Autodesk
from Autodesk.Revit.DB import *

clr.AddReference('RevitServices')
import RevitServices
from RevitServices.Persistence import DocumentManager
from RevitServices.Transactions import TransactionManager

#自定义函数region
#def

#全局变量
doc = DocumentManager.Instance.CurrentDBDocument
uiapp = DocumentManager.Instance.CurrentUIApplication
app = uiapp.Application

#该节点的输入内容将存储为 IN 变量中的一个列表。
dataEnteringNode = IN
elements = UnwrapElement(IN[0])

#事务处理
# "Start" the transaction
TransactionManager.Instance.EnsureInTransaction(doc)
for e in elements:
    doc.Delete(e.Id)
# "End" the transaction
TransactionManager.Instance.TransactionTaskDone()


#将输出内容指定给 OUT 变量。
OUT = 0
# ----------------------------------------
select_model_elements = DSModelElementsSelection()  # 2215 picked in the model
code_block = CodeBlock { "区域"; }
getParameterValueByName = Element.GetParameterValueByName(element=select_model_elements, parameterName=code_block)
code_block_2 = CodeBlock { "周边环境"; }
eq = getParameterValueByName == code_block_2
filterByBoolMask = List.FilterByBoolMask(list=select_model_elements, mask=eq)
