# Dynamo graph ModifyAdaptiveComponentPoint.dyn (Dynamo 0.9.1.4062)

select_model_element = DSModelElementSelection()
是否删除原来构件 = BoolSelector(true)
locations = AdaptiveComponent.Locations(select_model_element)

# group: 自适应点相关参数
要修改的点的id = CodeBlock { 5; }
在Z轴上偏移的距离 = CodeBlock { 1000; }

code_block = CodeBlock(index=要修改的点的id) { index-1; }
code_block_2 = CodeBlock(a=locations, index=code_block) { a[index]; }
ZAxis = Vector.ZAxis()
scale = Vector.Scale(vector=ZAxis, scale_factor=在Z轴上偏移的距离)
add = Point.Add(point=code_block_2, vectorToAdd=scale)
replaceItemAtIndex = List.ReplaceItemAtIndex(list=locations, index=code_block, item=add)
create = List.Create(replaceItemAtIndex)
type = AdaptiveComponent.Type(select_model_element)
byPoints = AdaptiveComponent.ByPoints(points=create, familyType=type)
code_block_3 = CodeBlock { "注释"; }
getParameterValueByName = Element.GetParameterValueByName(element=select_model_element, parameterName=code_block_3)
setParameterByName = Element.SetParameterByName(element=byPoints, parameterName=code_block_3, value=getParameterValueByName)
isNull = Object.IsNull(setParameterByName)
python_script = Python(IN[0]=select_model_element, IN[1]=是否删除原来构件, IN[2]=isNull)
# ---------- python_script.python (25 lines) ----------
import clr
clr.AddReference('ProtoGeometry')
from Autodesk.DesignScript.Geometry import *
#该节点的输入内容将存储为 IN 变量中的一个列表。

clr.AddReference('RevitAPI')
import Autodesk
from Autodesk.Revit.DB import *

clr.AddReference('RevitServices')
import RevitServices
from RevitServices.Persistence import DocumentManager
from RevitServices.Transactions import TransactionManager

dataEnteringNode = IN

if not IN[2] and IN[1]:
	doc = DocumentManager.Instance.CurrentDBDocument
	TransactionManager.Instance.EnsureInTransaction(doc)
	element = UnwrapElement(IN[0])
	doc.Delete(element.Id)
	TransactionManager.Instance.TransactionTaskDone()

#将输出内容指定给 OUT 变量。
OUT = 0
# ----------------------------------------
