# Dynamo graph ModifyParaValues.dyn (Dynamo 0.9.1.4062)

select_model_elements = DSModelElementsSelection()  # 10 picked in the model
code_block = CodeBlock { "构件编码"; }
getParameterValueByName = Element.GetParameterValueByName(element=select_model_elements, parameterName=code_block)
code_block_2 = CodeBlock { "-1"; "-4"; }
replace = String.Replace(str=getParameterValueByName, searchFor=code_block_2.out0, replaceWith=code_block_2.out1)
code_block_3 = CodeBlock { "H"; "G"; }
replace_2 = String.Replace(str=replace, searchFor=code_block_3.out0, replaceWith=code_block_3.out1)
setParameterByName = Element.SetParameterByName(element=select_model_elements, parameterName=code_block, value=replace_2)  # frozen
