# Dynamo graph PlaceFamilyIns.dyn (Dynamo 0.9.1.4062)

file_path = Filename("C:\Users\Administrator\Desktop\金鸡湖模型资料\洋红圆.txt")
getCoordinates = Python(IN[0]=file_path)
# ---------- getCoordinates.python (19 lines) ----------
import clr
clr.AddReference('ProtoGeometry')
from Autodesk.DesignScript.Geometry import *
#该节点的输入内容将存储为 IN 变量中的一个列表。
dataEnteringNode = IN

point_list = []

with open(IN[0], 'r') as f:
    lines = f.readlines()
    for line in lines:
        data = line.split('\t')
        x = float(data[0].strip()) 
        y = float(data[1].strip()) 
        p = Point.ByCoordinates(x, y)
        point_list.append(p)

#将输出内容指定给 OUT 变量。
OUT = point_list
# ----------------------------------------
levels = Levels("标高 1")
byPointAndLevel = FamilyInstance.ByPointAndLevel()
family_types = FamilyTypes("水泥土搅拌桩-插型钢:800 mm")
