# Dynamo graph SetParameter.dyn (Dynamo 0.9.1.4062)

select_model_elements = DSModelElementsSelection()  # 26 picked in the model
code_block = CodeBlock { "构件编码"; }
getParameterValueByName = Element.GetParameterValueByName(element=select_model_elements, parameterName=code_block)
code_block_2 = CodeBlock { "-5"; }
code_block_3 = CodeBlock(a=getParameterValueByName, b=code_block_2) { a+b; }
setParameterByName = Element.SetParameterByName(element=select_model_elements, parameterName=code_block, value=code_block_3)
