# Dynamo graph UndergroundPipeline_test.dyn (Dynamo 1.0.0.692)

create = List.Create()
file_path = Filename("C:\Users\Administrator\Desktop\地下管线生成\CZ07-TX - test.xlsx")
fromPath = FileObject(file_path)  # "File.FromPath"
sheetName = StringInput("L")
readFromFile = Excel.ReadFromFile(file=fromPath, sheetName=sheetName)
transpose = List.Transpose(readFromFile)
number = DoubleInput(20)
getItemAtIndex = List.GetItemAtIndex(list=transpose, index=number)
flatten = Flatten(getItemAtIndex)
number_2 = DoubleInput(1)
dropItems = List.DropItems(list=flatten, amount=number_2)
number_3 = DoubleInput(21)
getItemAtIndex_2 = List.GetItemAtIndex(list=transpose, index=number_3)
flatten_2 = Flatten(getItemAtIndex_2)
number_4 = DoubleInput(1)
dropItems_2 = List.DropItems(list=flatten_2, amount=number_4)
number_5 = DoubleInput(4)
getItemAtIndex_3 = List.GetItemAtIndex(list=transpose, index=number_5)
flatten_3 = Flatten(getItemAtIndex_3)
number_6 = DoubleInput(1)
dropItems_3 = List.DropItems(list=flatten_3, amount=number_6)
byCoordinates = Point.ByCoordinates(x=dropItems, y=dropItems_2, z=dropItems_3)
number_7 = DoubleInput(22)
getItemAtIndex_4 = List.GetItemAtIndex(list=transpose, index=number_7)
flatten_4 = Flatten(getItemAtIndex_4)
number_8 = DoubleInput(1)
dropItems_4 = List.DropItems(list=flatten_4, amount=number_8)
number_9 = DoubleInput(23)
getItemAtIndex_5 = List.GetItemAtIndex(list=transpose, index=number_9)
flatten_5 = Flatten(getItemAtIndex_5)
number_10 = DoubleInput(1)
dropItems_5 = List.DropItems(list=flatten_5, amount=number_10)
number_11 = DoubleInput(5)
getItemAtIndex_6 = List.GetItemAtIndex(list=transpose, index=number_11)
flatten_6 = Flatten(getItemAtIndex_6)
number_12 = DoubleInput(1)
dropItems_6 = List.DropItems(list=flatten_6, amount=number_12)
byCoordinates_2 = Point.ByCoordinates(x=dropItems_4, y=dropItems_5, z=dropItems_6)
combine = List.Combine(create, byCoordinates, byCoordinates_2)
watch = Watch(combine)
family_types = FamilyTypes("方形管道:方形管道")
byPoints = AdaptiveComponent.ByPoints(points=watch, familyType=family_types)
parameters = Element.Parameters(byPoints)
setParameterByName = Element.SetParameterByName()
code_block = CodeBlock { "宽"; }
number_13 = DoubleInput(24)
getItemAtIndex_7 = List.GetItemAtIndex(list=transpose, index=number_13)
flatten_7 = Flatten(getItemAtIndex_7)
code_block_2 = CodeBlock { 1; }
dropItems_7 = List.DropItems(list=flatten_7, amount=code_block_2)
toNumber = String.ToNumber(dropItems_7)
code_block_3 = CodeBlock { 0.001; }
mul = toNumber * code_block_3
apply = ApplyFunction(setParameterByName, byPoints, code_block, mul)  # "Function.Apply"
parameters_2 = Element.Parameters(apply)
setParameterByName_2 = Element.SetParameterByName()
code_block_4 = CodeBlock { "材质"; }
code_block_5 = CodeBlock { 6; }
getItemAtIndex_8 = List.GetItemAtIndex(list=transpose, index=code_block_5)
flatten_8 = Flatten(getItemAtIndex_8)
dropItems_8 = List.DropItems(list=flatten_8, amount=code_block_2)
apply_2 = ApplyFunction(setParameterByName_2, byPoints, code_block_4, dropItems_8)  # "Function.Apply"
setParameterByName_3 = Element.SetParameterByName()
code_block_6 = CodeBlock { "管道名称"; }
code_block_7 = CodeBlock { 16; }
getItemAtIndex_9 = List.GetItemAtIndex(list=transpose, index=code_block_7)
flatten_9 = Flatten(getItemAtIndex_9)
dropItems_9 = List.DropItems(list=flatten_9, amount=code_block_2)
apply_3 = ApplyFunction(setParameterByName_3, byPoints, code_block_6, dropItems_9)  # "Function.Apply"
