# Dynamo graph dixiaguanxian.dyn (Dynamo 1.3.2.2480)

create = List.Create()  # unwired: arg0, arg1
file_path = Filename("%E5%9C%B0%E4%B8%8B%E7%AE%A1%E7%BA%BF%E7%94%9F%E6%88%90\CZ07-TX.xlsx")
fromPath = FileObject(file_path)  # "File.FromPath"
sheetName = StringInput("L")
readFromFile = Excel.ReadFromFile(file=fromPath, sheetName=sheetName)
transpose = List.Transpose(readFromFile)
number = DoubleInput(20)
getItemAtIndex = List.GetItemAtIndex(list=transpose, index=number)
flatten = Flatten(getItemAtIndex)
number_2 = DoubleInput(1)
dropItems = List.DropItems(list=flatten, amount=number_2)
number_3 = DoubleInput(21)
getItemAtIndex_2 = List.GetItemAtIndex(list=transpose, index=number_3)
flatten_2 = Flatten(getItemAtIndex_2)
number_4 = DoubleInput(1)
dropItems_2 = List.DropItems(list=flatten_2, amount=number_4)
number_5 = DoubleInput(4)
getItemAtIndex_3 = List.GetItemAtIndex(list=transpose, index=number_5)
flatten_3 = Flatten(getItemAtIndex_3)
number_6 = DoubleInput(1)
dropItems_3 = List.DropItems(list=flatten_3, amount=number_6)
byCoordinates = Point.ByCoordinates(x=dropItems, y=dropItems_2, z=dropItems_3)
number_7 = DoubleInput(22)
getItemAtIndex_4 = List.GetItemAtIndex(list=transpose, index=number_7)
flatten_4 = Flatten(getItemAtIndex_4)
number_8 = DoubleInput(1)
dropItems_4 = List.DropItems(list=flatten_4, amount=number_8)
number_9 = DoubleInput(23)
getItemAtIndex_5 = List.GetItemAtIndex(list=transpose, index=number_9)
flatten_5 = Flatten(getItemAtIndex_5)
number_10 = DoubleInput(1)
dropItems_5 = List.DropItems(list=flatten_5, amount=number_10)
number_11 = DoubleInput(5)
getItemAtIndex_6 = List.GetItemAtIndex(list=transpose, index=number_11)
flatten_6 = Flatten(getItemAtIndex_6)
number_12 = DoubleInput(1)
dropItems_6 = List.DropItems(list=flatten_6, amount=number_12)
byCoordinates_2 = Point.ByCoordinates(x=dropItems_4, y=dropItems_5, z=dropItems_6)
combine = List.Combine(create, byCoordinates, byCoordinates_2)
watch = Watch(combine)
family_types = FamilyTypes("方形管道:方形管道")
byPoints = AdaptiveComponent.ByPoints(points=watch, familyType=family_types)
parameters = Element.Parameters(byPoints)
getParameterValueByName = Element.GetParameterValueByName()  # unwired: element, parameterName
number_13 = DoubleInput(24)
getItemAtIndex_7 = List.GetItemAtIndex(list=transpose, index=number_13)
flatten_7 = Flatten(getItemAtIndex_7)
deconstruct = List.Deconstruct(list=flatten_7)
watch_2 = Watch()  # unwired: arg0
python_script = Python()  # unwired: IN[0], IN[1], IN[2]; starter script, not edited (OUT = 0)
setParameterByName = Element.SetParameterByName(lacing=Longest)  # unwired: element, parameterName, value
setParameterByName_2 = Element.SetParameterByName()  # unwired: element, parameterName, value
create_2 = List.Create(byPoints)  # unwired: arg1
code_block = CodeBlock { para="宽度"; }
apply = ApplyFunction(setParameterByName_2, create_2, code_block)  # "Function.Apply"; unwired: arg3
watch_3 = Watch(code_block)
code_block_2 = CodeBlock {  }
