# Dynamo graph 写参数值到文件.dyn (Dynamo 0.9.1.4062)

select_model_elements = DSModelElementsSelection()  # 20 picked in the model
code_block = CodeBlock { {"区域","监测类型","监测对象","构件编码"}; }
getParameterValueByName = Element.GetParameterValueByName(element=select_model_elements, parameterName=code_block, lacing=CrossProduct)
python_script = Python(IN[0]=getParameterValueByName)
# ---------- python_script.python (21 lines) ----------
import clr
clr.AddReference('ProtoGeometry')
from Autodesk.DesignScript.Geometry import *
#该节点的输入内容将存储为 IN 变量中的一个列表。

#若要导入第三方库，需下面两行代码
import sys
sys.path.append(r'C:\Program Files (x86)\IronPython 2.7\Lib')

import codecs
dataEnteringNode = IN

with codecs.open(r'C:\Users\Administrator\Desktop\新建文件夹\00.txt', 'w', 'utf-8') as f:
    for linedata in IN[0]:
        line = '\t'.join(linedata)
        f.write(line)
        f.write('\n')


#将输出内容指定给 OUT 变量。
OUT = 0
# ----------------------------------------
