# Dynamo graph 管片角度.dyn (Dynamo 0.9.1.4062)

# group: 输入
选择管片 = DSModelElementsSelection()  # 50 picked in the model
txt文件路径 = Filename("C:\Users\Administrator\Desktop\jiaodu.txt")

code_block = CodeBlock { "角度"; }
fileDatas = Python(IN[0]=txt文件路径)
# ---------- fileDatas.python (15 lines) ----------
import clr
clr.AddReference('ProtoGeometry')
from Autodesk.DesignScript.Geometry import *
#该节点的输入内容将存储为 IN 变量中的一个列表。
dataEnteringNode = IN
txtFile = IN[0]
numList = []
txt = ''
with open(txtFile,'r') as f:
    txt = f.readlines()
for s in txt:
    if s.strip() != '':
        numList.append(float(s.strip()))
#将输出内容指定给 OUT 变量。
OUT = numList
# ----------------------------------------
setParameterByName = Element.SetParameterByName(element=选择管片, parameterName=code_block, value=fileDatas)
